# Dynamo graph DisenoVial_AutomatizacionCompleta.dyn (Dynamo 3.5.2.8914)
# Automatizacion diseno vial Civil 3D 2026

capa_eje_de_camino = StringInput("EJE DE CAMINO")
nombre_alineamiento = StringInput("ALI-EJE")
paso_1_crear_alineamiento = Python(IN[0]=capa_eje_de_camino, IN[1]=nombre_alineamiento)  # IronPython2
# ---------- paso_1_crear_alineamiento.python (88 lines) ----------
# PASO 1: Alineamiento desde polilinea en capa "EJE DE CAMINO"
# Requiere paquete DynamoIronPython2.7. Salida unica: OUT = [alignment_id, log]
import clr, math
clr.AddReference('AcMgd'); clr.AddReference('AcDbMgd'); clr.AddReference('AeccDbMgd')
from Autodesk.AutoCAD.ApplicationServices import Application
from Autodesk.AutoCAD.DatabaseServices import *
from Autodesk.AutoCAD.Geometry import Point3d
from Autodesk.Civil.ApplicationServices import CivilApplication
from Autodesk.Civil.DatabaseServices import Alignment

layer_name = IN[0]
ali_name   = IN[1]
doc  = Application.DocumentManager.MdiActiveDocument
db   = doc.Database
cdoc = CivilApplication.ActiveDocument

def norm(s):
    import unicodedata
    return ''.join(c for c in unicodedata.normalize('NFD', unicode(s))
                   if unicodedata.category(c) != 'Mn').upper()

def sty(col, *ns):
    for n in ns:
        try: return col[n]
        except: pass
    for s in col: return s
    return ObjectId.Null

try:
    tgt = norm(layer_name)
    pid = None
    with doc.LockDocument():
        with db.TransactionManager.StartTransaction() as tr:
            bt  = tr.GetObject(db.BlockTableId, OpenMode.ForRead)
            btr = tr.GetObject(bt[BlockTableRecord.ModelSpace], OpenMode.ForRead)
            for oid in btr:
                obj = tr.GetObject(oid, OpenMode.ForRead)
                if norm(obj.Layer) == tgt and isinstance(obj, (Polyline, Polyline2d, Polyline3d)):
                    pid = oid; break
            tr.Commit()
    if pid is None:
        raise ValueError(u'No se encontro polilinea en la capa: ' + layer_name)
    ast = sty(cdoc.Styles.AlignmentStyles, 'Standard', u'Est\xe1ndar', 'Estandar')
    lst = sty(cdoc.Styles.LabelSetStyles.AlignmentLabelSetStyles, 'Standard', '_No Labels')
    aid, log = None, ''
    with doc.LockDocument():
        with db.TransactionManager.StartTransaction() as tr:
            try:
                aid = Alignment.CreateFromPolyline(cdoc, ali_name, ObjectId.Null,
                          pid, 'C-ROAD-CNTR', ast, lst, False, True)
                log = u'[OK] Alineamiento creado (arcos preservados).'
                tr.Commit()
            except Exception as e:
                tr.Abort()
                log = u'[WARN] CreateFromPolyline fallo: ' + str(e) + u' -> manual.'
                with doc.LockDocument():
                    with db.TransactionManager.StartTransaction() as t2:
                        pl = t2.GetObject(pid, OpenMode.ForRead)
                        aid = Alignment.Create(cdoc, ali_name, ObjectId.Null,
                                               'C-ROAD-CNTR', ast, lst)
                        ents = t2.GetObject(aid, OpenMode.ForWrite).Entities
                        nv = pl.NumberOfVertices
                        rng = range(nv) if pl.Closed else range(nv - 1)
                        for i in rng:
                            j = (i + 1) % nv
                            p1 = pl.GetPoint3dAt(i); p2 = pl.GetPoint3dAt(j)
                            bv = pl.GetBulgeAt(i)
                            if abs(bv) < 1e-12:
                                ents.AddFixedLine(Point3d(p1.X,p1.Y,0.0),
                                                  Point3d(p2.X,p2.Y,0.0))
                            else:
                                t = 4.0*math.atan(abs(bv))
                                d = math.sqrt((p2.X-p1.X)**2+(p2.Y-p1.Y)**2)
                                r = d/(2.0*math.sin(t/2.0))
                                mx,my = (p1.X+p2.X)/2.0,(p1.Y+p2.Y)/2.0
                                dm = math.sqrt(max(0.0, r*r-(d/2.0)**2))
                                ca = math.atan2(p2.Y-p1.Y, p2.X-p1.X)
                                cw = bv < 0
                                pp = ca + (math.pi/2.0 if not cw else -math.pi/2.0)
                                c = Point3d(mx+dm*math.cos(pp), my+dm*math.sin(pp), 0.0)
                                sa = math.atan2(p1.Y-c.Y, p1.X-c.X)
                                ea = math.atan2(p2.Y-c.Y, p2.X-c.X)
                                ents.AddFixedArc(c, r, sa, ea, cw)
                        t2.Commit()
                        log += u' Alineamiento manual OK.'
    OUT = [aid, log]
except Exception as ex:
    OUT = [None, u'[ERROR P1] ' + str(ex)]
# ----------------------------------------
nombre_rasante = StringInput("RASANTE")
nombre_assembly = StringInput("camino")
nombre_superficie_tn = StringInput("TN")
nombre_superficie_sello = StringInput("SELLO")
delta_metros = DoubleInput(0.3)
paso_2_crear_sello = Python(IN[0]=nombre_superficie_tn, IN[1]=nombre_superficie_sello, IN[2]=delta_metros, IN[3]=paso_1_crear_alineamiento)  # IronPython2
# ---------- paso_2_crear_sello.python (61 lines) ----------
# PASO 2: SELLO = TN - delta
# IN[0]=tn_name IN[1]=sello_name IN[2]=delta IN[3]=salida_PASO1 (lista)
# Salida unica: OUT = [sello_id, tn_id, log]
import clr
clr.AddReference('AcMgd'); clr.AddReference('AcDbMgd'); clr.AddReference('AeccDbMgd')
from Autodesk.AutoCAD.ApplicationServices import Application
from Autodesk.AutoCAD.DatabaseServices import *
from Autodesk.AutoCAD.Geometry import Point3d, Point3dCollection
from Autodesk.Civil.ApplicationServices import CivilApplication
from Autodesk.Civil.DatabaseServices import TinSurface

tn_name    = IN[0]
sello_name = IN[1]
delta      = float(IN[2])
p1 = IN[3]  # [alignment_id, log] del PASO 1 (solo fuerza orden)
doc  = Application.DocumentManager.MdiActiveDocument
db   = doc.Database
cdoc = CivilApplication.ActiveDocument

def find_surf(name):
    for sid in cdoc.GetSurfaceIds():
        with db.TransactionManager.StartTransaction() as tr:
            s = tr.GetObject(sid, OpenMode.ForRead); tr.Commit()
            if s.Name.upper() == name.upper(): return sid
    return None

def sty(col, *ns):
    for n in ns:
        try: return col[n]
        except: pass
    for s in col: return s
    return ObjectId.Null

try:
    if p1 is None or p1[0] is None:
        raise ValueError(u'PASO 1 no entrego alineamiento. Revisar PASO 1.')
    tn_id = find_surf(tn_name)
    if tn_id is None:
        raise ValueError(u'Superficie TN no encontrada: ' + tn_name)
    ex = find_surf(sello_name)
    if ex is not None:
        with doc.LockDocument():
            with db.TransactionManager.StartTransaction() as tr:
                tr.GetObject(ex, OpenMode.ForWrite).Erase(); tr.Commit()
    st = sty(cdoc.Styles.SurfaceStyles, 'Standard', u'Est\xe1ndar', 'Estandar')
    with doc.LockDocument():
        with db.TransactionManager.StartTransaction() as tr:
            tn  = tr.GetObject(tn_id, OpenMode.ForRead)
            pts = Point3dCollection()
            for v in tn.Vertices:
                L = v.Location
                pts.Add(Point3d(L.X, L.Y, L.Z - delta))
            sid = TinSurface.Create(cdoc, sello_name)
            srf = tr.GetObject(sid, OpenMode.ForWrite)
            if st != ObjectId.Null: srf.StyleId = st
            srf.AddVertices(pts)
            srf.Rebuild()
            tr.Commit()
    OUT = [sid, tn_id, u'[OK] SELLO = TN - %.3f m (%d vertices)' % (delta, pts.Count)]
except Exception as ex:
    OUT = [None, None, u'[ERROR P2] ' + str(ex)]
# ----------------------------------------
paso_3_vista_de_perfil = Python(IN[0]=paso_1_crear_alineamiento, IN[1]=paso_2_crear_sello)  # IronPython2
# ---------- paso_3_vista_de_perfil.python (57 lines) ----------
# PASO 3: Vista de perfil con TN y SELLO
# IN[0]=salida_PASO1 IN[1]=salida_PASO2 ; OUT = [profile_view_id, log]
import clr
clr.AddReference('AcMgd'); clr.AddReference('AcDbMgd'); clr.AddReference('AeccDbMgd')
from Autodesk.AutoCAD.ApplicationServices import Application
from Autodesk.AutoCAD.DatabaseServices import *
from Autodesk.AutoCAD.Geometry import Point3d
from Autodesk.Civil.ApplicationServices import CivilApplication
from Autodesk.Civil.DatabaseServices import Profile, ProfileView

p1 = IN[0]   # [alignment_id, log]
p2 = IN[1]   # [sello_id, tn_id, log]
doc  = Application.DocumentManager.MdiActiveDocument
db   = doc.Database
cdoc = CivilApplication.ActiveDocument

def sty(col, *ns):
    for n in ns:
        try: return col[n]
        except: pass
    for s in col: return s
    return ObjectId.Null

def surf_profile(tr, ali_id, surf_id, name, layer_oid):
    ali = tr.GetObject(ali_id, OpenMode.ForRead)
    for pid in ali.GetProfileIds():
        if tr.GetObject(pid, OpenMode.ForRead).Name == name:
            return pid
    ps = sty(cdoc.Styles.ProfileStyles, 'Standard', u'Est\xe1ndar', 'Estandar')
    ls = sty(cdoc.Styles.LabelSetStyles.ProfileLabelSetStyles, '_No Labels', 'Standard')
    return Profile.CreateFromSurface(name, ali_id, surf_id, layer_oid, ps, ls)

try:
    if p1 is None or p1[0] is None:
        raise ValueError(u'PASO 1 sin alineamiento.')
    if p2 is None or p2[0] is None:
        raise ValueError(u'PASO 2 sin superficie SELLO.')
    alignment_id = p1[0]
    sello_id     = p2[0]
    tn_id        = p2[1]
    pvs = sty(cdoc.Styles.ProfileViewStyles, 'Standard', u'Est\xe1ndar', 'Estandar')
    with doc.LockDocument():
        with db.TransactionManager.StartTransaction() as tr:
            ali = tr.GetObject(alignment_id, OpenMode.ForRead)
            ext = ali.GeometricExtents
            ins = Point3d(ext.MaxPoint.X + 150.0, ext.MinPoint.Y, 0.0)
            cl  = db.Clayer
            surf_profile(tr, alignment_id, tn_id,    u'PERF-TN',    cl)
            surf_profile(tr, alignment_id, sello_id, u'PERF-SELLO', cl)
            pv_id = ProfileView.Create(alignment_id, ins)
            pv = tr.GetObject(pv_id, OpenMode.ForWrite)
            pv.Name = u'PV-EJE'
            if pvs != ObjectId.Null: pv.StyleId = pvs
            tr.Commit()
    OUT = [pv_id, u'[OK] Vista de perfil PV-EJE con TN y SELLO.']
except Exception as ex:
    OUT = [None, u'[ERROR P3] ' + str(ex)]
# ----------------------------------------
paso_4_crear_corredor = Python(IN[0]=paso_1_crear_alineamiento, IN[1]=nombre_rasante, IN[2]=nombre_assembly, IN[3]=paso_2_crear_sello, IN[4]=paso_3_vista_de_perfil)  # IronPython2
# ---------- paso_4_crear_corredor.python (83 lines) ----------
# PASO 4: Corredor con rasante existente y assembly "camino"
# IN[0]=salida_PASO1 IN[1]=profile_name IN[2]=assembly_name
# IN[3]=salida_PASO2 IN[4]=salida_PASO3 ; OUT = [corridor_id, log]
import clr
clr.AddReference('AcMgd'); clr.AddReference('AcDbMgd'); clr.AddReference('AeccDbMgd')
from Autodesk.AutoCAD.ApplicationServices import Application
from Autodesk.AutoCAD.DatabaseServices import *
from Autodesk.Civil.ApplicationServices import CivilApplication
from Autodesk.Civil.DatabaseServices import Corridor

p1 = IN[0]
profile_name  = IN[1]
assembly_name = IN[2]
p2 = IN[3]
p3 = IN[4]
doc  = Application.DocumentManager.MdiActiveDocument
db   = doc.Database
cdoc = CivilApplication.ActiveDocument

def sty(col, *ns):
    for n in ns:
        try: return col[n]
        except: pass
    for s in col: return s
    return ObjectId.Null

def find_profile(ali_id, name):
    with db.TransactionManager.StartTransaction() as tr:
        ali = tr.GetObject(ali_id, OpenMode.ForRead)
        found, names = None, []
        for pid in ali.GetProfileIds():
            p = tr.GetObject(pid, OpenMode.ForRead)
            names.append(p.Name)
            if p.Name.upper() == name.upper(): found = pid
        tr.Commit()
    return found, names

def find_assembly(name):
    import unicodedata
    def n(s):
        return ''.join(c for c in unicodedata.normalize('NFD', unicode(s))
                       if unicodedata.category(c) != 'Mn').upper()
    tgt = n(name)
    with db.TransactionManager.StartTransaction() as tr:
        for aid in cdoc.GetAssemblyIds():
            if n(tr.GetObject(aid, OpenMode.ForRead).Name) == tgt:
                tr.Commit(); return aid
        tr.Commit()
    return None

try:
    if p1 is None or p1[0] is None:
        raise ValueError(u'PASO 1 sin alineamiento.')
    if p3 is None or p3[0] is None:
        raise ValueError(u'PASO 3 sin vista de perfil.')
    alignment_id = p1[0]
    prof_id, avail = find_profile(alignment_id, profile_name)
    if prof_id is None:
        raise ValueError(u'Rasante no encontrada: ' + profile_name +
                         u'. Disponibles: ' + str(avail))
    asm_id = find_assembly(assembly_name)
    if asm_id is None:
        raise ValueError(u'Assembly no encontrado: ' + assembly_name)
    cst = sty(cdoc.Styles.CorridorStyles, 'Standard', u'Est\xe1ndar', 'Estandar')
    with doc.LockDocument():
        with db.TransactionManager.StartTransaction() as tr:
            ali = tr.GetObject(alignment_id, OpenMode.ForRead)
            s0, s1 = ali.StartingStation, ali.EndingStation
            cor_id = Corridor.Create(cdoc, u'CORREDOR-EJE')
            cor = tr.GetObject(cor_id, OpenMode.ForWrite)
            if cst != ObjectId.Null: cor.StyleId = cst
            bl  = cor.Baselines.Add(u'BL-EJE', alignment_id, prof_id)
            reg = bl.BaselineRegions.Add(u'REG-1', asm_id)
            try:
                reg.StartStation = s0
                reg.EndStation   = s1
            except: pass
            cor.Rebuild()
            tr.Commit()
    OUT = [cor_id, u'[OK] Corredor: assembly=' + assembly_name +
           u', rasante=' + profile_name]
except Exception as ex:
    OUT = [None, u'[ERROR P4] ' + str(ex)]
# ----------------------------------------
watch_resultado = Watch(paso_4_crear_corredor)
